% Simulink data dictionary battery.sldd

ALPHA = -5.738
BETA = 209.9
LOWER_VOLT_CF = 2.75
T_AMB = 298
UPPER_VOLT_CF = 4.2
OCV_ALPHA = 0.15
OCV_BETA = 17
OCV_GAMMA = 10.5
OCV_V0 = 4.14
OCV_VL = 3.977
INTERNAL_RESISTANCE = 0.12
NOMINAL_CAPACITY = 14400
EHC_A = 4.0e-5
EHC_KAPPA = 3
EHC_MU = 0.4
EHC_SIGMA = 0.05
EHC_LAMBDA = 7
EHC_B = 5.0e-5
T_REF = 298

COULOMBIC_EFFICIENCIES = [1 0.5 0.9992869
 0.75 0.625 0.9992899
 0.75 0.375 0.9993109
 0.5 0.75 0.9992759
 0.5 0.5 0.9993059
 0.5 0.25 0.9993239
 0.25 0.875 0.9993139
 0.25 0.625 0.9992979
 0.25 0.5 0.9992949
 0.25 0.375 0.9993299
 0.25 0.125 0.9993409]

HEAT_CAPACITY = 2288.8086
C_AIR = 40.6854
R_AIR = 0.0562
R_IN = 0.2915
R_OUT = 0.0954